# Dynamo graph Floor Pattern Creator V 1.2.dyn (Dynamo 2.12.1.8246)
# packages: bimorphNodes 4.2.4, Genius Loci 2023.1.23

# group: Get Lines
a_select_cad_file = Filename("Patterns\ID-FL- CE.01.04-WET_AREA.dwg")  # graph input
views = Views("Ref. Level")
import_dwg = Custom[Import DWG](Filepaths=a_select_cad_file, views=views)  # package Genius Loci; Import DWGs in views with options. Use with the Enumerate DWG import options node. Based on an archilab's script.
curvesFromCADLayers = CAD.CurvesFromCADLayers(importInstance=import_dwg.ImportInstance)

# group: Thickness
thickness = DoubleSlider(2, range=0.2..10 step 0.1)  # graph input
extrude = Curve.Extrude(curve=curvesFromCADLayers.Curve, distance=thickness)

# group: Depth
depth = DoubleSlider(6, range=0.2..1000 step 1)  # graph input
thicken = Surface.Thicken(surface=extrude, thickness=depth)

# group: Union
byUnion = Solid.ByUnion(solids=thicken)
list_clean = Custom[List Clean](list=byUnion)  # package Genius Loci; Removes all Null, Empty and Blank from a list or nested list of lists.
byUnion_2 = Solid.ByUnion(solids=list_clean)

# group: Void Extortion
code_block = CodeBlock { 0.3048; }
scale = Geometry.Scale(geometry=byUnion_2, xamount=code_block, yamount=code_block, zamount=code_block)
string_from_object = FromObject(object=import_dwg.Name)
categories = Categories("OST_GenericModel")
file_path = Filename("C:\ProgramData\Autodesk\RVT 2022\Family Templates\English\Metric Generic Model face based.rft")
string_from_object_2 = FromObject(object=file_path)
voidByGeometry = FamilyType.VoidByGeometry(solidGeometry=scale, name=string_from_object, category=categories, templatePath=string_from_object_2)

# group: Remove Autocad
categories_2 = Categories("OST_ImportObjectStyles")
all_elements_of_category = ElementsOfCategory(Category=categories_2)
boolean = BoolSelector(false)
setPinnedStatus = Element.SetPinnedStatus(element=all_elements_of_category, pinned=boolean)
delete = Element.Delete(element=setPinnedStatus)
