# Dynamo graph Floor Pattern Creator V 1.0.dyn (Dynamo 2.12.1.8246)
# packages: bimorphNodes 4.2.4, Genius Loci 2023.1.23

a_select_cad_file = Filename("C:\Users\TULPAR\Desktop\fga.dwg")  # graph input
views = Views("Level 1")
import_dwg = Custom[Import DWG](Filepaths=a_select_cad_file, views=views)  # package Genius Loci; Import DWGs in views with options. Use with the Enumerate DWG import options node. Based on an archilab's script.

# group: Get Lines
curvesFromCADLayers = CAD.CurvesFromCADLayers(importInstance=import_dwg.ImportInstance)

# group: Thickness
thickness = DoubleSlider(2, range=0..10 step 1)  # graph input
extrude = Curve.Extrude(curve=curvesFromCADLayers.Curve, distance=thickness)

string = StringInput("Void Cut ")  # graph input
code_block = CodeBlock { 1.5; }

# group: Depth
code_block_2 = CodeBlock { 6; }
thicken = Surface.Thicken(surface=extrude, thickness=code_block_2)
material_1_wood_2_else = DoubleSlider(1, range=1..2 step 1)
code_block_3 = CodeBlock { 1; }
gt = material_1_wood_2_else > code_block_3
code_block_4 = CodeBlock { 0.1; }
if_ = RefactoredIf(test=gt, true=code_block_4, false=code_block)

# group: Union
byUnion = Solid.ByUnion(solids=thicken)
list_clean = Custom[List Clean](list=byUnion)  # package Genius Loci; Removes all Null, Empty and Blank from a list or nested list of lists.
byUnion_2 = Solid.ByUnion(solids=list_clean)

# group: Void Extortion
code_block_5 = CodeBlock { 0.3048; }
scale = Geometry.Scale(geometry=byUnion_2, xamount=code_block_5, yamount=code_block_5, zamount=code_block_5)
categories = Categories("OST_GenericModel")
file_path = Filename("C:\ProgramData\Autodesk\RVT 2022\Family Templates\English\Metric Generic Model face based.rft")
string_from_object = FromObject(object=file_path)
voidByGeometry = FamilyType.VoidByGeometry(solidGeometry=scale, name=string, category=categories, templatePath=string_from_object)
